# Grasshopper definition Diagnose.gh (Grasshopper 1.0.7)

# ---- group: RH_IN:BOUNDARY_PX
px = GetNumber("0", AtLeast=1, AtMost=2147483647, Maximum=1.797693135e+308, Minimum=-1.797693135e+308)

# ---- group: RH_IN:BOUNDARY_PY
py = GetNumber("0", AtLeast=1, AtMost=2147483647, Maximum=1.797693135e+308, Minimum=-1.797693135e+308)

# ---- group: RH_IN:BOUNDARY_DX
dx = GetNumber("7500", AtLeast=1, AtMost=2147483647, Maximum=1.797693135e+308, Minimum=-1.797693135e+308)

# ---- group: RH_IN:BOUNDARY_DY
dy = GetNumber("10500", AtLeast=1, AtMost=2147483647, Maximum=1.797693135e+308, Minimum=-1.797693135e+308)

# ---- group: RH_IN:ROOM1_PX
px_2 = GetNumber("4800", AtLeast=1, AtMost=2147483647, Maximum=1.797693135e+308, Minimum=-1.797693135e+308)

# ---- group: RH_IN:ROO1M_PY
py_2 = GetNumber("3600", AtLeast=1, AtMost=2147483647, Maximum=1.797693135e+308, Minimum=-1.797693135e+308)

# ---- group: RH_IN:ROOM1_DY
dy_2 = GetNumber("8400", AtLeast=1, AtMost=2147483647, Maximum=1.797693135e+308, Minimum=-1.797693135e+308)

# ---- group: RH_IN:ROOM1_DX
dx_2 = GetNumber("3000", AtLeast=1, AtMost=2147483647, Maximum=1.797693135e+308, Minimum=-1.797693135e+308)

# ---- group: RH_IN:PATH1_PX
px_3 = GetNumber("7800", AtLeast=1, AtMost=2147483647, Maximum=1.797693135e+308, Minimum=-1.797693135e+308)

# ---- group: RH_IN:PATH1_PY
py_3 = GetNumber("2400", AtLeast=1, AtMost=2147483647, Maximum=1.797693135e+308, Minimum=-1.797693135e+308)

# ---- group: RH_IN:PATH1_DY
dy_3 = GetNumber("600", AtLeast=1, AtMost=2147483647, Maximum=1.797693135e+308, Minimum=-1.797693135e+308)

# ---- group: RH_IN:PATH1_DX
dx_3 = GetNumber("8400", AtLeast=1, AtMost=2147483647, Maximum=1.797693135e+308, Minimum=-1.797693135e+308)

# ---- group: RH_IN:PATH2_PX
px_4 = GetNumber("7200", AtLeast=1, AtMost=2147483647, Maximum=1.797693135e+308, Minimum=-1.797693135e+308)

# ---- group: RH_IN:PATH2_PY
py_4 = GetNumber("7200", AtLeast=1, AtMost=2147483647, Maximum=1.797693135e+308, Minimum=-1.797693135e+308)

# ---- group: RH_IN:PATH2_DY
dy_4 = GetNumber("600", AtLeast=1, AtMost=2147483647, Maximum=1.797693135e+308, Minimum=-1.797693135e+308)

# ---- group: RH_IN:PATH2_DX
dx_4 = GetNumber("4200", AtLeast=1, AtMost=2147483647, Maximum=1.797693135e+308, Minimum=-1.797693135e+308)

# ----
boundary = Room(x_coordinate=px, y_coordinate=py, x_size=dx, y_size=dy)
room = Room(x_coordinate=px_3, y_coordinate=py_3, x_size=dx_3, y_size=dy_3)
room_2 = Room(x_coordinate=px_4, y_coordinate=py_4, x_size=dx_4, y_size=dy_4)
room_3 = Room(x_coordinate=px_2, y_coordinate=py_2, x_size=dx_2, y_size=dy_2)
curve = Curve(boundary)
curve_2 = Curve(room_3)
curve_3 = Curve(room)
curve_4 = Curve(room_2)
wall_extraction = Wall_extraction(curve=curve, integer0_west=0, integer1_south=1, integer2_north=2, integer3_east=3)  # -> curve_4, center_2, curve0_west_2, curve1_south_2, curve2_north_2, curve3_east_2
wall_extraction_2 = Wall_extraction(curve=curve_3, integer0_west=0, integer1_south=1, integer2_north=2, integer3_east=3)  # -> curve_4, center_2, curve0_west_2, curve1_south_2, curve2_north_2, curve3_east_2
wall_extraction_3 = Wall_extraction(curve=curve_2, integer0_west=0, integer1_south=1, integer2_north=2, integer3_east=3)  # -> curve_4, center_2, curve0_west_2, curve1_south_2, curve2_north_2, curve3_east_2
wall_extraction_4 = Wall_extraction(curve=curve_4, integer0_west=0, integer1_south=1, integer2_north=2, integer3_east=3)  # -> curve_4, center_2, curve0_west_2, curve1_south_2, curve2_north_2, curve3_east_2
package = GhPythonScript(
    curve=wall_extraction.curve_4,
    point=wall_extraction.center_2,
    wall0_west=wall_extraction.curve0_west_2,
    wall1_south=wall_extraction.curve1_south_2,
    wall2_north=wall_extraction.curve2_north_2,
    wall3_east=wall_extraction.curve3_east_2)  # -> out, flatten(pach)
# ---------- package: Python ----------
__author__ = "SHU"
__version__ = "2021.03.11"

import rhinoscriptsyntax as rs

pach = []

pach.append(curve)
pach.append(point)
pach.append(wall0_west)
pach.append(wall1_south)
pach.append(wall2_north)
pach.append(wall3_east)
# ---------- end package ----------
package_2 = GhPythonScript(
    curve=wall_extraction_2.curve_4,
    point=wall_extraction_2.center_2,
    wall0_west=wall_extraction_2.curve0_west_2,
    wall1_south=wall_extraction_2.curve1_south_2,
    wall2_north=wall_extraction_2.curve2_north_2,
    wall3_east=wall_extraction_2.curve3_east_2)  # -> out, flatten(pach); same code as package
package_3 = GhPythonScript(
    curve=wall_extraction_4.curve_4,
    point=wall_extraction_4.center_2,
    wall0_west=wall_extraction_4.curve0_west_2,
    wall1_south=wall_extraction_4.curve1_south_2,
    wall2_north=wall_extraction_4.curve2_north_2,
    wall3_east=wall_extraction_4.curve3_east_2)  # -> out, flatten(pach); same code as package
package_4 = GhPythonScript(
    curve=wall_extraction_3.curve_4,
    point=wall_extraction_3.center_2,
    wall0_west=wall_extraction_3.curve0_west_2,
    wall1_south=wall_extraction_3.curve1_south_2,
    wall2_north=wall_extraction_3.curve2_north_2,
    wall3_east=wall_extraction_3.curve3_east_2)  # -> out, flatten(pach); same code as package
ghpython_script = GhPythonScript(boundary=package.pach, path1=package_2.pach, path2=package_3.pach, room1=package_4.pach)  # -> out, flatten(packages), flatten(room_names), flatten(rooms); inputs boundary: list, path1: list, path2: list, room1: list
# ---------- ghpython_script: Python ----------
__author__ = "SHU"
__version__ = "2021.04.16"

import rhinoscriptsyntax as rs
import ghpythonlib.components as ghcomp

#输入全部原始变量
PACKAGES = [boundary, path1, path2, room1]
            
       
ROOM_NAMES = ['boundary', 'path1', 'path2', 'room1']



#print(PACKAGES)
#print(ROOM_NAMES)

ROOMS = [] #房间曲线
for item in PACKAGES:
    room = item[0]    
    ROOMS.append(room) 
print(ROOMS)

rooms = ROOMS
packages = PACKAGES
room_names = ROOM_NAMES

print(packages)
# ---------- end ghpython_script ----------
relation_judgment = GhPythonScript(packages=ghpython_script.packages, room_names=ghpython_script.room_names)  # -> flatten(out), room_center, rooms_origional; inputs packages: list, room_names: list, path: Curve
# ---------- relation_judgment: Python ----------
__author__ = "SHU"
__version__ = "2021.03.20"

import rhinoscriptsyntax as rs
import ghpythonlib.components as ghcomp

#输入全部原始变量
            
PACKAGES = packages
ROOM_NAMES = room_names

#print(PACKAGES)
#print(ROOM_NAMES)

ROOMS = [] #房间曲线

for item in PACKAGES:
    room = item[0]    
    ROOMS.append(room) 

#print(ROOMS)
#print('------------')
rooms_origional = ROOMS

######
######构建临接字典
DICTIONARY = {}    #字典键为房间名，值顺序为从r1-rn房间名称

for item in ROOM_NAMES:
    DICTIONARY[item] = []
#print(DICTIONARY)

######空间关系判断
def space_measure(room1, room2, index1, index2):
    
    center1 = PACKAGES[index1][1]
    center2 = PACKAGES[index2][1]
    depth1 = ghcomp.Length(PACKAGES[index1][2])
    depth2 = ghcomp.Length(PACKAGES[index2][2])
    width1 = ghcomp.Length(PACKAGES[index1][3])
    width2 = ghcomp.Length(PACKAGES[index2][3])   
    
    x_distance = abs(center1[0] - center2[0])
    y_distance = abs(center1[1] - center2[1])
    
    x_reference = (width1 + width2)/2
    y_reference = (depth1 + depth2)/2
    x_reference1 = abs((width1 - width2)/2)
    y_reference1 = abs((depth1 - depth2)/2)
    
    
    #判断相离
    if x_distance >= x_reference or y_distance >= y_reference:
        list = [1, 0, 0]
    
    #判断是否外切
    elif x_distance == x_reference and y_distance < y_reference:
        list = [2, 0, int(y_reference - y_distance)] #返回外切标记，以及共线长度
    elif x_distance < x_reference and y_distance == y_reference:
        list = [2, 0, int(x_reference - x_distance)] #返回外切标记，以及共线长度
        
    #判断相交           
    elif x_distance < x_reference and y_distance < y_reference and (x_distance > x_reference1 or y_distance > y_reference1):
        intersection = ghcomp.RegionIntersection(room1, room2)
        area = ghcomp.Area(intersection)  
        list = [3, int(area['area']), 0] #返回相交标记，相交面积
        
    elif y_distance < y_reference and x_distance > x_reference1 and y_distance > y_reference:
        intersection = ghcomp.RegionIntersection(room1, room2)
        area = ghcomp.Area(intersection)  
        list = [3, int(area['area']), 0] #返回相交标记，相交面积        
        
    #判断内切
    elif x_distance == x_reference1 and y_distance == y_reference1:
        intersection = ghcomp.RegionIntersection(room1, room2)
        area = ghcomp.Area(intersection)
        list = [4, int(area['area']), 0] #返回内切标记，相交面积
    elif x_distance == x_reference1 and y_distance < y_reference1:
        intersection = ghcomp.RegionIntersection(room1, room2)
        area = ghcomp.Area(intersection)
        list = [4, int(area['area']), 0] #返回内切标记，相交面积
    elif x_distance < x_reference1 and y_distance == y_reference1:
        intersection = ghcomp.RegionIntersection(room1, room2)
        area = ghcomp.Area(intersection)
        list = [4, int(area['area']), 0] #返回内切标记，相交面积
    
    #判断包含
    elif x_distance < x_reference1 and y_distance < y_reference1:
        intersection = ghcomp.RegionIntersection(room1, room2)
        area = ghcomp.Area(intersection)
        list = [5, int(area['area']), 0] #返回包含标记，以及相交面积   
    
    #其它情况
    else:  #重合时，相交点向量为[0,0,0]
        list = [6, 0, 0] 

    #print(ROOM_NAMES[index1], ROOM_NAMES[index2])
    #print(list)
    
    return list
            
######构建邻接矩阵及信息数据
for i, j in enumerate(ROOMS):
    for m, n in enumerate(ROOMS):  
    
        #判断是否是同一个房间
        if j == n:
            DICTIONARY[ROOM_NAMES[i]].append([-1,-1,-1])            
        else:
            out = space_measure(j, n, i, m)            
            DICTIONARY[ROOM_NAMES[i]].append(out) 

###打印房间邻接关系信息
print(DICTIONARY)   #[空间关系标记，相交面积, 共线长度]
# ---------- end relation_judgment ----------

# ---- group: RH_OUT:SPACIAL_INFO
panel = Panel(relation_judgment.out)

# ==== cluster Room
y_coordinate = ClusterInput()
x_coordinate = ClusterInput()
y_size = ClusterInput()
x_size = ClusterInput()
construct_point = ConstructPoint(XCoordinate=x_coordinate, YCoordinate=y_coordinate, ZCoordinate=0)
xy_plane = XYPlane(Origin=construct_point)
rectangle = Rectangle(Plane=xy_plane, XSize=x_size, YSize=y_size, Radius=0)  # -> Rectangle, Length
rectangle_2 = ClusterOutput(rectangle.Rectangle)

# ==== cluster Wall_extraction
integer1_south = ClusterInput()
integer0_west = ClusterInput()
integer2_north = ClusterInput()
integer3_east = ClusterInput()
curve = ClusterInput()
curve_2 = Curve(curve)
integer0_west_2 = Integer(integer0_west)
integer1_south_2 = Integer(integer1_south)
integer2_north_2 = Integer(integer2_north)
integer3_east_2 = Integer(integer3_east)
polygon_center = PolygonCenter(Polyline=curve_2)  # -> CenterV, CenterE, CenterA
line_west = Line_west(mesh=curve_2, integer=integer0_west_2)
select_line2 = Line_west(mesh=curve_2, integer=integer1_south_2)
select_line3 = Line_west(mesh=curve_2, integer=integer2_north_2)
select_line4 = Line_west(mesh=curve_2, integer=integer3_east_2)
curve_3 = Curve(curve_2)
curve1_south = Curve(select_line2)
curve2_north = Curve(select_line3)
curve0_west = Curve(line_west)
curve3_east = Curve(select_line4)
center = Point(polygon_center.CenterV)
curve_4 = ClusterOutput(curve_3)
center_2 = ClusterOutput(center)
curve0_west_2 = ClusterOutput(curve0_west)
curve2_north_2 = ClusterOutput(curve2_north)
curve1_south_2 = ClusterOutput(curve1_south)
curve3_east_2 = ClusterOutput(curve3_east)

# ==== cluster Line_west
mesh = ClusterInput()
integer = ClusterInput()
mesh_edges = MeshEdges(Mesh=mesh)  # -> flatten(NakedEdges), InteriorEdges, NonManifoldEdges
integer_2 = Integer(integer)
construct_domain = ConstructDomain(DomainStart=integer_2, DomainEnd=integer_2)
sub_list = SubList(List=mesh_edges.NakedEdges, Domain=construct_domain, Wrap=True)  # -> List, Index
curve = Curve(sub_list.List)
curve_2 = ClusterOutput(curve)
